# Grasshopper definition rammed_earth_20211220.gh (Grasshopper 1.0.7)
# plug-ins: KUKA|prc - parametric robot control

stepper_move_time = Slider(5, range=0..10)
纵向点间距 = Slider(22, range=0..100)
横向点间距 = Slider(20, range=0..100)
模式选择 = Slider(0, range=0..2)
x = Slider(568.92, range=0..1000)
y = Slider(-90.28, range=-100..100)
z = Slider(32.47, range=0..100)

panel = Panel("初始点距底高度30mm")
construct_point = ConstructPoint(XCoordinate=x, YCoordinate=y, ZCoordinate=z)

d = Slider(20, range=0..100)
subtraction = Subtraction(A="150", B=d)
纵向打印高度 = Slider(63, range=0..1000)

division = Division(A="90", B=d)
circle = Circle(Plane=construct_point, Radius=d)
round = Round(Number=division)  # -> Nearest, Floor, Ceiling
area = Area(Geometry=circle)  # -> Area, Centroid
divide_curve = DivideCurve(Curve=circle, Count=Slider(6, range=0..10), Kinks=False)  # -> Points, Tangents, Parameters
series = Series(Start=0, Step=d, Count=round.Nearest)
merge = Merge(Data1=area.Centroid, Data2=divide_curve.Points)  # -> flatten(Result)
unit_z = UnitZ(Factor=series)
move = Move(Geometry=merge, Motion=graft(unit_z))  # -> flatten(Geometry), Transform
list_length = ListLength(List=move.Geometry)
range = Range(Domain=Domain(0, 1), Steps=expr("x-1", list_length))

division_2 = Division(A="50", B=d)
rectangle = Rectangle(Plane=construct_point, XSize=d, YSize=d, Radius=0)  # -> Rectangle, Length
round_2 = Round(Number=division_2)  # -> Nearest, Floor, Ceiling
box_rectangle = BoxRectangle(Rectangle=rectangle.Rectangle, Height=d)
box_array = BoxArray(
    Geometry=construct_point,
    Cell=box_rectangle,
    XCount=expr("x+1", round_2.Nearest),
    YCount=expr("x+1", round_2.Nearest),
    ZCount=expr("x+1", round_2.Nearest))  # -> Geometry, Transform
list_length_2 = ListLength(List=box_array.Geometry)
range_2 = Range(Domain=Domain(0, 1), Steps=expr("x-1", list_length_2))

radians = Radians(Degrees=Slider(90, range=0..100))
rectangle_2 = Rectangle(Plane=construct_point, XSize=纵向打印高度, YSize=subtraction, Radius=0)  # -> Rectangle, Length
xz_plane = XZPlane(Origin=construct_point)
division_3 = Division(A=subtraction, B=横向点间距)
division_4 = Division(A=纵向打印高度, B=纵向点间距)
rotate = Rotate(Geometry=rectangle_2.Rectangle, Angle=radians, Plane=xz_plane)  # -> Geometry, Transform
round_3 = Round(Number=division_3)  # -> Nearest, Floor, Ceiling
round_4 = Round(Number=division_4)  # -> Nearest, Floor, Ceiling
divide_surface = DivideSurface(Surface=reparameterize(rotate.Geometry), UCount=round_4.Nearest, VCount=round_3.Nearest)  # -> flatten(Points), Normals, flatten(Parameters)
image_sampler = ImageSampler(
    divide_surface.Parameters,
    FilePath="Z:\Documents\01_G_Lab\02_项目\017_机械臂夯土打印\01_3d model\01_Rhino\20211220_打印路径\589d1e0e49d50.jpeg",
    Filter="Value",
    Interpolate=False,
    Umax=1,
    Umin=0,
    Vmax=1,
    Vmin=0,
    Wrap=2)
flip_matrix = FlipMatrix(Data=divide_surface.Points)  # -> flatten(Data)

stream_filter = StreamFilter(Gate=模式选择, Stream0=image_sampler, Stream1=range_2, Stream2=range)
stream_filter_2 = StreamFilter(Gate=模式选择, Stream0=divide_surface.Points, Stream1=box_array.Geometry, Stream2=move.Geometry)

gradient = Gradient(LowerLimit=0, UpperLimit=1, Parameter=stream_filter, stops=[0: RGB(255, 0, 0), 1: RGB(255, 215, 0)])
dot_display = DotDisplay(Point=stream_filter_2, Colour=gradient, Size=Slider(4, range=0..10))

ghpython_script = GhPythonScript(x=stream_filter)  # -> a
# ---------- ghpython_script: Python ----------
__author__ = "zhangjun"
__version__ = "2021.10.30"

import rhinoscriptsyntax as rs
import math

a = round(x, 1)
# ---------- end ghpython_script ----------
list_length_3 = ListLength(List=stream_filter)

digital_output_kuka_prc = DigitalOutputKUKAPrc(DigitalOutputNumber=graft("9"), OutputState=[Toggle(True), Toggle(False)], ContinuousMovement=False, ToolState=-1)
multiplication = Multiplication(A=list_length_3, B=Slider(2, range=0..10))
repeat_data = RepeatData(Data=digital_output_kuka_prc, Length=multiplication)
partition_list = PartitionList(List=repeat_data, Size="2")  # -> simplify(Chunks)
merge_2 = Merge(Data1=Slider(10, range=0..10), Data2=Slider(2.5, range=0..10))
panel_2 = Panel("""1
-1""")
insert_items = InsertItems(List=partition_list, Item=merge_2, Indices=panel_2, Wrap=True)  # -> simplify(List)

digital_output_kuka_prc_2 = DigitalOutputKUKAPrc(DigitalOutputNumber=graft("6"), OutputState=[Toggle(True), Toggle(False)], ContinuousMovement=False, ToolState=-1)
multiplication_2 = Multiplication(A=list_length_3, B=Slider(2, range=0..10))
repeat_data_2 = RepeatData(Data=digital_output_kuka_prc_2, Length=multiplication_2)
partition_list_2 = PartitionList(List=repeat_data_2, Size="2")  # -> simplify(Chunks)
insert_items_2 = InsertItems(List=partition_list_2, Item=Slider(1, range=0..10), Indices="1", Wrap=True)  # -> simplify(List)

radians_2 = Radians(Degrees=Slider(0, range=0..1000))
xy_plane = XYPlane(Origin=stream_filter_2)
rotate_plane = RotatePlane(Plane=xy_plane, Angle=radians_2)
subtraction_2 = Subtraction(A="1", B=ghpython_script)
linear_movement_kuka_prc = LINearMovementKUKAPrc(TargetAsPlane=rotate_plane, extaxenabled=False, interpolation="C_DIS")
absolute = Absolute(Value=subtraction_2)
entwine = Entwine(Branch00=ghpython_script, Branch01=absolute, FlattenInputs=True)
cartesian_offset_kuka_prc = CartesianOffsetKUKAPrc(
    KUKAPrcCommand=linear_movement_kuka_prc,
    CartesianX=0,
    CartesianY=0,
    CartesianZ=Slider(100, range=0..1000),
    OffsetStart=True,
    OffsetEnd=True)  # -> simplify(graft(KUKAPrcCommand))
multiplication_3 = Multiplication(A=entwine, B=stepper_move_time)  # -> simplify(Result)
panel_3 = Panel("使用安全距离之后，会额外再列表开头结尾生成两个点。但是这两个点不参与电机运动，因此要从列表第二个点开始对位。")
explode_tree = ExplodeTree(Data=multiplication_3)  # -> graft(Branch0), graft(Branch1)

digital_output_kuka_prc_3 = DigitalOutputKUKAPrc(DigitalOutputNumber="4", OutputState=[Toggle(True), Toggle(False)], ContinuousMovement=False, ToolState=-1)
multiplication_4 = Multiplication(A=list_length_3, B=Slider(2, range=0..10))
repeat_data_3 = RepeatData(Data=digital_output_kuka_prc_3, Length=multiplication_4)
partition_list_3 = PartitionList(List=repeat_data_3, Size="2")  # -> simplify(Chunks)
match_tree = MatchTree(Tree=explode_tree.Branch0, Guide=partition_list_3)
equality = Equality(FirstNumber=match_tree, SecondNumber="0")  # -> Equality, Inequality
insert_items_3 = InsertItems(List=partition_list_3, Item=match_tree, Indices="1", Wrap=True)  # -> simplify(List)
cull_pattern = CullPattern(List=insert_items_3, CullPattern=equality.Inequality)

digital_output_kuka_prc_4 = DigitalOutputKUKAPrc(DigitalOutputNumber=graft("5"), OutputState=[Toggle(True), Toggle(False)], ContinuousMovement=False, ToolState=-1)
multiplication_5 = Multiplication(A=list_length_3, B=Slider(2, range=0..10))
repeat_data_4 = RepeatData(Data=digital_output_kuka_prc_4, Length=multiplication_5)
partition_list_4 = PartitionList(List=repeat_data_4, Size="2")  # -> simplify(Chunks)
match_tree_2 = MatchTree(Tree=explode_tree.Branch1, Guide=partition_list_4)
equality_2 = Equality(FirstNumber=match_tree_2, SecondNumber="0")  # -> Equality, Inequality
insert_items_4 = InsertItems(List=partition_list_4, Item=match_tree_2, Indices="1", Wrap=True)  # -> simplify(List)
cull_pattern_2 = CullPattern(List=insert_items_4, CullPattern=equality_2.Inequality)

panel_4 = Panel(explode_tree.Branch1)
panel_5 = Panel(insert_items)

list_item = ListItem(List=cull_pattern_2, Index="1", Wrap=True)
list_item_2 = ListItem(List=cull_pattern, Index="1", Wrap=True)

equality_3 = Equality(FirstNumber=list_item_2, SecondNumber=list_item)  # -> Equality, Inequality
dispatch = Dispatch(List=cull_pattern, DispatchPattern=equality_3.Equality)  # -> ListA, ListB
dispatch_2 = Dispatch(List=cull_pattern_2, DispatchPattern=equality_3.Equality)  # -> ListA, ListB
cull_index = CullIndex(List=dispatch_2.ListA, Indices="1", Wrap=True)
panel_6 = Panel("""0
1
0
0
1""")
weave = Weave(Pattern=panel_6, Stream0=dispatch.ListA, Stream1=cull_index, NullGaps=False)  # -> simplify(Weave)

subtraction_3 = Subtraction(A=list_item_2, B=list_item)
absolute_2 = Absolute(Value=subtraction_3)

smaller_than = SmallerThan(FirstNumber=list_item_2, SecondNumber=list_item)  # -> SmallerThan, OrEqualTo
dispatch_3 = Dispatch(List=cull_pattern_2, DispatchPattern=smaller_than.SmallerThan)  # -> ListA, ListB
dispatch_4 = Dispatch(List=cull_pattern, DispatchPattern=smaller_than.SmallerThan)  # -> ListA, ListB
panel_7 = Panel("""0
1
0
0
1
1""")
replace_items = ReplaceItems(List=dispatch_3.ListA, Item=absolute_2, Indices="1", Wrap=False)
weave_2 = Weave(Pattern=panel_7, Stream0=dispatch_4.ListA, Stream1=replace_items, NullGaps=False)  # -> simplify(Weave)

larger_than = LargerThan(FirstNumber=list_item_2, SecondNumber=list_item)  # -> LargerThan, OrEqualTo
dispatch_5 = Dispatch(List=cull_pattern_2, DispatchPattern=larger_than.LargerThan)  # -> ListA, ListB
dispatch_6 = Dispatch(List=cull_pattern, DispatchPattern=larger_than.LargerThan)  # -> ListA, ListB
panel_8 = Panel("""0
1
1
1
0
0""")
replace_items_2 = ReplaceItems(List=dispatch_6.ListA, Item=absolute_2, Indices="1", Wrap=False)
weave_3 = Weave(Pattern=panel_8, Stream0=replace_items_2, Stream1=dispatch_5.ListA, NullGaps=False)  # -> simplify(Weave)

equality_4 = Equality(FirstNumber=list_item, SecondNumber=stepper_move_time)  # -> Equality, Inequality
cull_pattern_3 = CullPattern(List=cull_pattern_2, CullPattern=equality_4.Equality)

equality_5 = Equality(FirstNumber=list_item_2, SecondNumber=stepper_move_time)  # -> Equality, Inequality
cull_pattern_4 = CullPattern(List=cull_pattern, CullPattern=equality_5.Equality)

servo_beforestart = Slider(3, range=0..10)
duplicate_data = DuplicateData(Data=servo_beforestart, Number=list_length_3, Order=True)  # -> simplify(graft(Data))
merge_3 = Merge(Data1=cull_pattern_4, Data2=weave_2, Data3=weave_3, Data4=weave, Data5=cull_pattern_3)
merge_4 = Merge(Data1=merge_3, Data2=duplicate_data, Data3=insert_items)

data = Data(merge_4)
smaller_than_2 = SmallerThan(FirstNumber=data, SecondNumber=Slider(10, range=0..10))  # -> SmallerThan, OrEqualTo
cull_pattern_5 = CullPattern(List=data, CullPattern=smaller_than_2.OrEqualTo)
wait_kuka_prc = WaitKUKAPrc(KUKAPrcWait=cull_pattern_5)
item_index = ItemIndex(List=data, Item=cull_pattern_5)
replace_items_3 = ReplaceItems(List=data, Item=wait_kuka_prc, Indices=item_index, Wrap=False)  # -> simplify(List)

path_mapper = PathMapper(replace_items_3, source="{A}", target="{A+1}")
panel_9 = Panel("""2
-2""")
merge_5 = Merge(Data1=cartesian_offset_kuka_prc, Data2=path_mapper)  # -> flatten(Result)
insert_items_5 = InsertItems(List=merge_5, Item=digital_output_kuka_prc_2, Indices=panel_9, Wrap=True)

custom_tool_kuka_prc = CustomToolKUKAPrc(toolid=4, toolvala=0, toolvalb=0, toolvalc=0, toolvalx=324.67, toolvaly=-2.27, toolvalz=86.62, valuesset=True)
agilus_kr6_10_r900_robot = AgilusKR610R900Robot(infiniterot=False)
kuka_prc_core = KUKAPrcCORE(
    SimulationSlider=Slider(0.767, range=0..1),
    KUKAPrcCommands=insert_items_5,
    Tool=custom_tool_kuka_prc,
    Robot=agilus_kr6_10_r900_robot,
    SaveToggle=Button(),
    Filename="rammed_earth_20211221",
    PRC_BaseExpose=False,
    PRC_SaveNameExpose=True,
    PRCsettings="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")  # -> RobotGeometry, AnalysisOutput

panel_10 = Panel(insert_items_5)
